# Grasshopper definition SpikyThing.gh (Grasshopper 1.0.7)
# plug-ins: MeshStreamer
# Spherical spikey thing

# ---- group: ctrl
radius = Slider(4.21, range=0..10)
count = Slider(33, range=1..100)
length = Slider(4.63, range=0..10)
density = Slider(1, range=1..3)

# ----
radius_2 = GetNumber(radius, AtLeast=1, AtMost=2147483647, Maximum=1.797693135e+308, Minimum=-1.797693135e+308, TreeAccess=False)
count_2 = GetInteger(count, AtLeast=1, AtMost=1, Maximum=2147483647, Minimum=-2147483648, TreeAccess=False)
length_2 = GetNumber(length, AtLeast=1, AtMost=2147483647, Maximum=1.797693135e+308, Minimum=-1.797693135e+308, TreeAccess=False)
density_2 = GetInteger(density, AtLeast=1, AtMost=1, Maximum=2147483647, Minimum=-2147483648, TreeAccess=False)
pt = ConstructPoint(XCoordinate=0, YCoordinate=0, ZCoordinate=0)
msphere = MeshSphere(Base=pt, Radius=radius_2, UCount=10, VCount=20)
popgeo = PopulateGeometry(Geometry=msphere, Count=count_2, Seed=1)
facet = FacetDome(Points=popgeo, Radius=radius_2)  # -> Pattern, Dome
explode = Explode(Curve=facet.Pattern, Recursive=True)  # -> Segments, Vertices
curvepoint = PointOnCurve(explode.Segments, parameter=0.5)
avr = Average(Input=curvepoint)
lng = ListLength(List=explode.Segments)
vec2pt = Vector2Pt(PointA=pt, PointB=avr, Unitize=invert(False))  # -> Vector, Length
amp = Amplitude(Vector=vec2pt.Vector, Amplitude=length_2)
addition = Addition(A=avr, B=amp)
end = EndPoints(Curve=graft(explode.Segments))  # -> Start, End
dup = DuplicateData(Data=addition, Number=lng, Order=True)
pshift = ShiftPaths(Data=dup, Offset=-1)  # -> graft(Data)
merge = Merge(Data1=end.Start, Data2=end.End, Data3=pshift)
triangle = MeshTriangle(CornerA=0, CornerB=1, CornerC=2)
conmesh = ConstructMesh(Vertices=merge, Faces=triangle)
mjoin = MeshJoin(Meshes=flatten(conmesh))
alignvert = AlignVertices(Mesh=mjoin, Tolerance=0.1)  # -> Result, Count
weld = WeldMesh(Mesh=alignvert.Result, Angle=3.141592654)
subdmesh = SubDFromMesh(Mesh=weld, Creases=1, Corners=1, Interpolate=False)
meshsubd = MeshFromSubD(SubD=subdmesh, Density=density_2)
demesh = DeconstructMesh(Mesh=meshsubd)  # -> Vertices, Faces, Colours, Normals
lng_2 = ListLength(List=demesh.Vertices)
series = Series(Start=0, Step=1, Count=lng_2)
gradient = Gradient(
    LowerLimit=0,
    UpperLimit=expr("x-1", lng_2),
    Parameter=series,
    stops=[0: RGB(0, 0, 255), 0.114: RGB(0, 115, 255), 0.228: RGB(0, 191, 255), 0.365: RGB(0, 255, 255), 0.486: RGB(0, 217, 0), 0.619: RGB(255, 255, 0), 0.742: RGB(255, 187, 0), 0.864: RGB(255, 128, 0), 1: RGB(214, 0, 0)])
mspray = MeshSpray(Mesh=meshsubd, Points=demesh.Vertices, Colours=gradient, SprayMode=1)
# enable if you want use direct mode
toggle = BooleanToggle(True)
meshuistream = MeshUIStreamer(Meshes=mspray, Groups="ctrl", Port=8081, Enable=toggle)  # -> Status, Clients, DataSize

# ---- group: RH_OUT:mesh
# used with rhinocompute mode
mesh = Mesh(mspray)

# ----
panel = Panel([meshuistream.Status, meshuistream.Clients, meshuistream.DataSize])
